# Grasshopper definition Snail.gh (Grasshopper 1.0.7)

python = GhPythonScript()  # -> out, file
# ---------- python: Python ----------
import rhinoscriptsyntax as rs

filter = "GCode (*.gcode)|*.gcode|All Files (*.*)|*.*||"
file = rs.SaveFileName("", filter)
# ---------- end python ----------
panel = Panel(python.out)
python_2 = GhPythonScript(file=python.file, sides=Slider(12, range=0..20), size=Slider(12, range=0..50), layers=Slider(24, range=0..500))  # -> out, lines, turtle, draw_bed; inputs sides: Int32, layers: Int32
# ---------- python_2: Python ----------
import rhinoscriptsyntax as rs
import random as r
import extruder_turtle
from extruder_turtle import *
import math

t = ExtruderTurtle()
forward = 1
t.setup(filename = file, printer = "ender")
extrude_rate = t.get_extrude_rate()
layer_height = t.get_layer_height()

length = 25
for i in range(0,layers):
    for i in  range(0,layers):
        t.forward(length)
        t.right(90)
        t.forward(forward)
        t.right(180-math.degrees(math.atan(length/forward)))
        t.lift(1)
        t.forward(math.sqrt(math.pow(forward,2)+math.pow(length,2)))
        t.penup()
        t.back(math.sqrt(math.pow(forward,2)+math.pow(length,2)))
        t.pendown()
        t.lift(-1)
        t.left(180-math.degrees(math.atan(length/forward)))
        t.forward(length-forward)
        forward += 1
    forward = 1
    t.lift(layer_height)

   

    
        

turtle = t.draw_turtle()
lines = t.get_lines()
t.finish()
# ---------- end python_2 ----------
